% Simulink data dictionary Motor_position_data.sldd

J = Simulink.Parameter(3.2284e-6)
Ke = Simulink.Parameter(0.0274)
Kt = Simulink.Parameter(0.0274)
L = Simulink.Parameter(2.75e-6)
R = Simulink.Parameter(4)
Ts = Simulink.Parameter(0.01)
b = Simulink.Parameter(3.5077e-6)